vi "ldpcDecoding.gvi"   [LabVIEW NXG]
inputs:
  "ReceivedMessage": i32[]
  "CheckMatrixLocation": path
  "itMax": i32
outputs:
  "CheckMatrix": f64[][]
  "MesageDecoded": i32[]
panel controls:
  "WaitBetweenIteration": bool
panel indicators:
  "Syndrom": f64[]
  "loop iteration": i32
  "Variable: indicator": f64[]
  "Variable: out": i32[]
  "error": i32
  "sizeMatrix": i32[]
  "sizeMessage": i32
diagram:
  call "Read from Spreadsheet File (DBL).gvi"(file path=$CheckMatrixLocation, format="%.3f", delimiter=",") -> (all rows=w1)
  $CheckMatrix <- w1
  s1 = $ReceivedMessage  # shift register
  while (iteration -> i1) {
    call "A x Vector.gvi"(A=w1, Vector=s1) -> (A x Vector=w2, error=w3)
    Quotient And Remainder(x=w2, y=2) -> (x-y*floor(x/y)=w4)
    $Syndrom <- w4
    $error <- w3
    Math Node("syndrom"=w4, "H"=w1, "in"=s1) -> ("out"=w5, "indicator"=w6)
    ~~~
    count=0;

    m=size(H,1);    % Number of checks
    n=size(H,2);    % Number of bits in codeword
    k=n-m;


        % Find the checks that are not respected
        syndrom;

        % For each bit count the number of checks respected and not respected
        res=zeros(1,n);
        notRes=zeros(1,n);

        indicator=[m n size(H) size(syndrom)];
        for bit=1:n
            for check=1:m
                if H(check, bit)==1
                    if syndrom(1, check)==1
                        notRes(bit)=notRes(bit)+1;
                    else
                        res(bit)=res(bit)+1;
                    end
                end
            end
        end

        % if more not respected flip the bit
        for bit=1:n
            if notRes(bit)>res(bit)
                in(bit)=mod(in(bit)+1,2);
            end
        end
        out=in;
    ~~~
    $"Variable: out" <- w5
    Array Size(array=w1) -> (size(s)=w7)
    $sizeMatrix <- w7
    $"Variable: indicator" <- w6
    Array Size(array=s1) -> (size(s)=w8)
    $sizeMessage <- w8
    case ($WaitBetweenIteration) {
      frame False, Default { }
      frame True {
        Wait Ms(msToWait=1500)
      }
    }
    $"loop iteration" <- i1
    Add Array Elements(numeric array=w4) -> (sum=w9)
    Is Equal To 0(x=w9) -> w10
    Is Greater(x=i1, y=$itMax) -> w11
    Logical Or(w11, w10) -> w12
    next s1 = w5
    stop if w12
  }
  Array Size(array=w1) -> (size(s)=w13)
  Array Index(array=w13) -> (out0[0]=w14)
  Array Index(array=w13) -> (out0[1]=w15)
  Subtract(x=w15, y=w14) -> w16
  Array Subset(array=s1, index0=w14, length0=w16) -> w17
  $MesageDecoded <- w17
