vi "ldpcDenseCoding.gvi"   [LabVIEW NXG]
inputs:
  "Message": f64[]
  "GeneratorMatrixLocation": path
outputs:
  "EncodedMessage": f64[]
panel indicators:
  "GeneratorMatrix": f64[][]
  "GeneratorMatrixSize": i32[]
  "Code": f64[]
  "error": i32
diagram:
  call "Read from Spreadsheet File (DBL).gvi"(file path=$GeneratorMatrixLocation, format="%.3f", delimiter=",") -> (all rows=w1)
  call "Vector x A.gvi"(vector V'=$Message, matrix A=w1) -> (V' x A=w2, error=w3)
  Quotient And Remainder(x=w2, y=2) -> (x-y*floor(x/y)=w4)
  Build Array[ConcatenateInputs=True]($Message, w4) -> w5
  $EncodedMessage <- w5
  $error <- w3
  $Code <- w4
  $GeneratorMatrix <- w1
  Array Size(array=w1) -> (size(s)=w6)
  $GeneratorMatrixSize <- w6
