vi "ldpcTest.gvi"   [LabVIEW NXG]
panel controls:
  "CheckMatrixLocation": path
  "Message": i32[]
  "GeneratorMatrixLocation": path
  "stop": bool
  "messageLength": i32
  "numberNoise": i32
panel indicators:
  "MesageDecoded": i32[]
  "matrixProduct": f64
  "Gsize": i32[]
  "Hsize": i32[]
  "sizeCodedMessage": i32
  "sizeNoisyMessage": i32
  "errorDecoding": i16
  "sumNoisyMessage": f64
diagram:
  while {
    Initialize Array(element=0, size=$messageLength, size=0) -> w1
    Reshape Array(inArray=w1, size=$messageLength) -> w2
    call "ldpcDenseCoding.gvi"(Message=w2, GeneratorMatrixLocation=$GeneratorMatrixLocation) -> (EncodedMessage=w3, GeneratorMatrix=w4)
    Build Array[ConcatenateInputs=True](w2, w2) -> w5
    Initialize Array(element=1, size=$numberNoise, size=1) -> w6
    Reshape Array(inArray=w6, size=$numberNoise) -> w7
    Replace Array Subset(inArray=w5, 2, w7) -> w8
    Add(w8, w3) -> w9
    Quotient And Remainder(x=w9, y=2) -> (x-y*floor(x/y)=w10)
    call "ldpcDecoding.gvi"(ReceivedMessage=w10, CheckMatrixLocation=$CheckMatrixLocation, itMax=3) -> (CheckMatrix=w11, MesageDecoded=w12)
    Is Not Equal(x=w2, y=w12) -> w13
    Boolean To Integer(Boolean=w13) -> (0, 1=w14)
    Add Array Elements(numeric array=w14) -> (sum=w15)
    $errorDecoding <- w15
    Array Size(array=w9) -> (size(s)=w16)
    $sizeNoisyMessage <- w16
    Add Array Elements(numeric array=w9) -> (sum=w17)
    $sumNoisyMessage <- w17
    $MesageDecoded <- w12
    Array Size(array=w11) -> (size(s)=w18)
    $Hsize <- w18
    call "Real A x B.gvi"(A=w11, B=w4) -> (A x B=w19)
    Quotient And Remainder(x=w19, y=2) -> (x-y*floor(x/y)=w20)
    Add Array Elements(numeric array=w20) -> (sum=w21)
    $matrixProduct <- w21
    Array Size(array=w3) -> (size(s)=w22)
    $sizeCodedMessage <- w22
    Array Size(array=w4) -> (size(s)=w23)
    $Gsize <- w23
    stop if $stop
  }
