vi "Rx_main.gvi"   [LabVIEW NXG]
panel controls:
  "IQ rate": f64 = 500000
  "carrier frequency": f64 = 2450000000
  "gain": f64 = 10
  "PSK type": enum{"normal", "shifted", "offset"} = "normal"
  "samples per symbol": i32 = 16
  "M-PSK": i32 = 4
  "modulation type": T1 = "PSK"
  "pulse shaping filter": T2 = "Root Raised Cos"
  "filter parameter": f64 = 0.5
  "stopFetchingLoop": bool
  "packet_size_with_padding": f64 = 10624
  "wanted_sync_index": f64 = 60
  "correction": f64 = 0.02
  "multiple": f64 = 10000
  "soundSamplesPerPacket": i32 = 128
  "bitsPerSample": i32 = 8
  "uLaw": bool
  "CheckMatrixLocation": path
  "LDPC": bool
  "LDPCitMax": i32
  "codingRate": f64 = 2
  "interleving": bool
  "lengthInterleaver": f64
  "toleranceInterleaver": f64
  "reset": bool
panel indicators:
  "Sync_Found?": bool
  "Sync_Index": f64
  "Demodulated IQ Graph": T3[]
  "SoundOutput": waveform<f64>[]
  "loop iteration": i32
  "InterleaverfoundSynchro": bool
  "deviationFrom010101...": i16[]
  "sumDeviationFrom010101...": u64
  "errorRate": f64
  "nbBitReceived": i32
  "packetReceived": f64[]
  "nonNullDeviationsFrom101010...": i16[]
types:
  T1 = enum{"FSK", "PSK", "QAM", "MSK", "PAM", "ASK", "CPM"}
  T2 = enum{"none", "Raised Cosine", "Root Raised Cos", "Gaussian"}
  T3 = cluster{"constellation": f64[], "oversampled data": f64[]}
  T4 = cluster{"sample rate": f64, "number of channels": i32, "bits per sample": i32}
  T5 = cluster{"samples per symbol (16)": i32, "symbol map": c128[], "differential PSK": enum{"disable", "enable"}, "PSK type": enum{"normal", "shifted", "offset"}}
  T6 = cluster{"expected sync location (symbols)": i32, "sync sequence": c128[], "sync location uncertainty (symbols)": i32, "sync indent (symbols)": i32}
  T7 = cluster{"psk_system_params": T5, "pulse_shaping_filter_coeffs": f64[], "matched_filter_coeffs": f64[], "sync_params": T6, "sync_seq_bits": i8[]}
diagram:
  w1 = T4 {"sample rate"=6000, "number of channels"=1, "bits per sample"=8}
  w2 = $wanted_sync_index
  w3 = $packet_size_with_padding
  w4 = $soundSamplesPerPacket
  w5 = $bitsPerSample
  w6 = $correction
  w7 = $multiple
  call "initPSK.gvi"(PSK type=$"PSK type", samples per symbol=$"samples per symbol", M-PSK=$"M-PSK", modulation type=$"modulation type", pulse shaping filter=$"pulse shaping filter", filter parameter=$"filter parameter", PSK_params_in=T7 {all zero or empty}) -> (PSK_params_out=w8)
  call "Sound Output Configure.gvi"(device ID=0, sound format=w1, number of samples per channel=8000) -> (task ID=w9, error out=w10)
  call "Sound Output Start.gvi"(task ID=w9, error in=w10) -> (task ID out=w11, error out=w12)
  call "Read from Spreadsheet File (DBL).gvi"(file path=$CheckMatrixLocation, format="%.3f", delimiter=",") -> (all rows=w13)
  call "niUSRP Open Rx Session.gvi"(Device names="192.168.10.2") -> (Error Out=w14, Session handle=w15)
  call "niUSRP Configure Signal.gvi"(session handle=w15, IQ rate=$"IQ rate", carrier frequency=$"carrier frequency", gain=$gain, error in (no error)=w14, active antenna="RX1") -> (session handle out=w16, Error Out=w17)
  call "niUSRP Initiate.gvi"(session handle=w16, error in (no error)=w17) -> (session handle out=w18, Error Out=w19)
  w20 = cluster{"t0": f64, "dt": f64, "Y": c128[]} {all zero or empty}
  w21 = $lengthInterleaver
  w22 = $toleranceInterleaver
  w23 = $interleving
  w24 = $LDPC
  w25 = $LDPCitMax
  s1 = w20  # shift register
  s2 = uninitialised  # shift register
  s3 = uninitialised  # shift register
  while (iteration -> i1) {
    call "demodulation_block.gvi"(data=s1, PSK_params_in=w8) -> (output bit stream=w26, recovered complex waveform=w27, Sync_Found?=w28, sync found index=w29)
    Is Greater Than 0(x=i1) -> w30
    case (w30) {
      frame False, Default {
        w31 = w3
        w32 = w18
        w33 = w19
      }
      frame True {
        Not(x=w30) -> w34
        call "adjust_Samples_to_sync.gvi"(wanted_sync_index=w2, current_sync_index=w29, packet_size_with_padding=w3, first_interation?=w34, sync_location_last_iteration=s2, samples_last_interation=s3) -> (new_NumOfSamples=w31)
        w32 = w18
        w33 = w19
      }
    }
    To Unsigned Quad Integer(number=w31) -> w35
    call "niUSRP Fetch Rx Data (CDB Cluster).gvi"(session handle=w32, number of samples=w35, error in (no error)=w33) -> (session handle out=w36, data=w37, Error Out=w38)
    $"loop iteration" <- i1
    Multiply(w4, w5) -> w39
    case (w24) {
      frame False, Default {
        w40 = w39
      }
      frame True {
        Multiply(w39, $codingRate) -> w40
      }
    }
    case (w23) {
      frame False, Default {
        w41 = w40
      }
      frame True {
        Add(w40, 10) -> w41
      }
    }
    call "extractDataBits.gvi"(appendedArray=w26, dataBitsPerPacket=w41) -> (dataArray=w42)
    case (w23) {
      frame False, Default {
        w43 = w42
        w44 = default
        w45 = default
      }
      frame True {
        call "Deinterleaver.gvi"(input=w42, lengthInterleaver=w21, tolerance=w22) -> (queueOut=w46, queueErrorOut=w47, foundSynchro=w48)
        Get Queue Status(error in (no error)=w47, queue=w46) -> (error out=w49, queue out=w50)
        Dequeue Element(error in (no error)=w49, queue=w50, timeout in ms (-1)=20) -> (element=w43, error out=w45, queue out=w44)
        $InterleaverfoundSynchro <- w48
      }
    }
    case (w24) {
      frame False, Default {
        w51 = w43
      }
      frame True {
        call "ldpcDecoding.gvi"(ReceivedMessage=w43, CheckMatrix=w13, itMax=w25) -> (MesageDecoded=w51)
        Array Size(array=w43) -> (size(s)=w52)
        Is Equal(x=w52, y=w40) -> w53
      }
    }
    call "soundBitStream2Integer.gvi"(bitStream=w51, numberOfSoundSamples=w4, bitsPerSample=w5) -> (integerArray=w54)
    case ($uLaw) {
      frame False, Default {
        To Double Precision Float(number=w54) -> w55
      }
      frame True {
        call "uLawDecodeArray8to16bits.gvi"(X=w54) -> (Y=w55)
      }
    }
    call "deShiftAndMultSoundArray.gvi"(unprocessedSoundArray=w55, correction=w6, multiple=w7) -> (processedArray=w56)
    Property Node(instance in=w1) -> ("sample rate"=w57)
    Reciprocal(x=w57) -> w58
    Build Waveform Node(Y=w56, dt=w58, t0=1904-01-01T00:00:00Z) -> (output waveform=w59)
    Build Array(w59, waveform<f64> {dt=1, Y=[]}) -> w60
    call "Sound Output Write.gvi"(task ID=w11, data=w60, error in=w12) -> (task ID out=w61, error out=w62)
    $"Sync_Found?" <- w28
    $Sync_Index <- w29
    $packetReceived <- w51
    $SoundOutput <- w60
    call "MT Format Constellation.gvi"(waveform=w27) -> (constellation graph=w63)
    $"Demodulated IQ Graph" <- w63
    Array Size(array=w51) -> (size(s)=w64)
    Is Greater Than 0(x=w64) -> w65
    case (w65) {
      frame False, Default { }
      frame True {
        Divide(x=w64, y=2) -> w66
        Initialize Array(element=0, size=w66) -> w67
        Initialize Array(element=1, size=w66) -> w68
        Interleave Array(w67, w68) -> w69
        Subtract(x=w51, y=w69) -> w70
        Is Not Equal To 0(x=w70) -> w71
        Boolean To Integer(Boolean=w71) -> (0, 1=w72)
        Add Array Elements(numeric array=w72) -> (sum=w73)
        Is Greater Than 0(x=w73) -> w74
        Feedback Node(Input=w75) -> (Output=w76)
        case (w74) {
          frame False, Default {
            w77 = w76
          }
          frame True {
            Build Array[ConcatenateInputs=True](w73, w76) -> w77
          }
        }
        case ($reset) {
          frame False, Default {
            w78 = w79
            w75 = w77
          }
          frame True {
            w78 = default
            w75 = default
          }
        }
        Feedback Node(Input=w78) -> (Output=w80)
        Build Array[ConcatenateInputs=True](w73, w80) -> w79
        $"deviationFrom010101..." <- w79
        $"nonNullDeviationsFrom101010..." <- w77
        Array Size(array=w79) -> (size(s)=w81)
        Multiply(w64, w81) -> w82
        $nbBitReceived <- w82
        To Unsigned Quad Integer(number=w79) -> w83
        Add Array Elements(numeric array=w83) -> (sum=w84)
        Divide(x=w84, y=w82) -> w85
        $errorRate <- w85
        $"sumDeviationFrom010101..." <- w84
      }
    }
    next s1 = w37
    next s2 = w29
    next s3 = w31
    stop if $stopFetchingLoop
  }
  Flush Queue(error in (no error)=w45, queue=w44) -> (error out=w86, queue out=w87)
  Release Queue(error in (no error)=w86, queue=w87)
  call "niUSRP Abort.gvi"(Handle in=w36, error in (no error)=w38) -> (Handle out=w88, Error Out=w89)
  call "niUSRP Close Session.gvi"(Handle in=w88, error in (no error)=w89)
  call "Sound Output Stop.gvi"(task ID=w61, error in=w62) -> (task ID out=w90, error out=w91)
  call "Sound Output Clear.gvi"(task ID=w90, error in=w91)
