vi "Tx_main.gvi"   [LabVIEW NXG]
panel controls:
  "IQ_Rate": f64 = 500000
  "f0": f64 = 2450000000
  "Gain": f64 = 10
  "modulation type": T1 = "PSK"
  "PSK type": enum{"normal", "shifted", "offset"} = "normal"
  "samples per symbol": i32 = 16
  "pulse shaping filter": T2 = "Root Raised Cos"
  "filter parameter": f64 = 0.5
  "filter length": i32 = 8
  "stopRecoringSound": bool
  "stopDataEnqueing": bool
  "stopSendingData": bool
  "SamplesPerChannel": i32 = 128
  "multiple": f64 = 1000
  "correction": f64 = 0.02
  "bitsPerSample": i32 = 8
  "uLaw": bool
  "LDPC": bool
  "GeneratorMatrixLocation": path
panel indicators:
  "data": waveform<f64>[]
  "PacketGraph": cluster{"t0": f64, "dt": f64, "Y": c128[]}
  "IQ Graph": T3[]
  "numOfElementInRadioQueue2": i32
  "numOfElementInSoundQueue": i32
  "numOfElementInSoundQueue2": i32
  "numOfElementInRadioQueue": i32
types:
  T1 = enum{"FSK", "PSK", "QAM", "MSK", "PAM", "ASK", "CPM"}
  T2 = enum{"none", "Raised Cosine", "Root Raised Cos", "Gaussian"}
  T3 = cluster{"constellation": f64[], "oversampled data": f64[]}
  T4 = cluster{"sample rate": f64, "number of channels": i32, "bits per sample": i32}
diagram:
  w1 = $SamplesPerChannel
  w2 = $bitsPerSample
  w3 = $correction
  w4 = $multiple
  Obtain Queue(element data type=i8[] [], max queue size (-1, unlimited)=2000, name (unnamed)="sound_bit_stream") -> (error out=w5, queue out=w6)
  w7 = T4 {"sample rate"=6000, "number of channels"=1, "bits per sample"=16}
  call "Sound Input Configure.gvi"(device ID=0, sound format=w7, sample mode=1, number of samples per channel=8000) -> (task ID=w8, error out=w9)
  call "Sound Input Start.gvi"(task ID=w8, error in=w9) -> (task ID out=w10, error out=w11)
  call "Read from Spreadsheet File (DBL).gvi"(file path=$GeneratorMatrixLocation, format="%.3f", delimiter=",") -> (all rows=w12)
  while {
    Multiply(w1, w2) -> w13
    call "Sound Input Read.gvi"(task ID=w10, error in=w11, number of samples per channel=w1, timeout=-1) -> (task ID out=w14, data=w15, error out=w16)
    for {
      w17 = each element of w15
      Property Node(instance in=w17) -> ("Y"=w18)
    }
    call "shiftAndMultSoundArray.gvi"(soundArray_raw=w18, correction=w3, multiply=w4) -> (processedSoundArray=w19)
    case ($uLaw) {
      frame False, Default {
        To Unsigned Byte Integer(number=w19) -> w20
      }
      frame True {
        call "uLawCodeArray16to8.gvi"(X=w19) -> (Y=w20)
      }
    }
    call "intArray2BitStream.gvi"(unsigned 8-bit integer=w20) -> (array=w21)
    Reshape Array(inArray=w21, size=w13) -> w22
    case ($LDPC) {
      frame False, Default {
        w23 = w22
      }
      frame True {
        call "ldpcDenseCoding.gvi"(Message=w22, generatorMatrix=w12) -> (EncodedMessage=w23)
      }
    }
    call "createPacket.gvi"(dataBitStream=w23) -> (packet=w24)
    Get Queue Status(error in (no error)=w5, queue=w6) -> (# elements in queue=w25, error out=w26, queue out=w27)
    Lossy Enqueue Element(element=w24, error in (no error)=w26, queue=w27)
    $data <- w15
    $numOfElementInSoundQueue <- w25
    stop if $stopRecoringSound
  }
  call "Sound Input Stop.gvi"(task ID=w14, error in=w16) -> (task ID out=w28, error out=w29)
  call "Sound Input Clear.gvi"(task ID=w28, error in=w29)
  w30 = $"samples per symbol"
  w31 = $"PSK type"
  w32 = $"modulation type"
  w33 = $"pulse shaping filter"
  w34 = $"filter parameter"
  w35 = $"filter length"
  w36 = cluster{"t0": f64, "dt": f64, "Y": c128[]} {"t0"=0, "dt"=1, "Y"=[]}
  Obtain Queue(element data type=w36, max queue size (-1, unlimited)=5000, name (unnamed)="enqueDataForRadio") -> (error out=w37, queue out=w38)
  call "niUSRP Open Tx Session.gvi"(Device names="192.168.10.2", Reset=TRUE) -> (Error Out=w39, Session handle=w40)
  call "niUSRP Configure Signal.gvi"(session handle=w40, IQ rate=$IQ_Rate, carrier frequency=$f0, gain=$Gain, error in (no error)=w39, active antenna="TX1") -> (session handle out=w41, coerced IQ rate=w42)
  while {
    Get Queue Status(error in (no error)=w5, queue=w6) -> (# elements in queue=w43, error out=w44, queue out=w45)
    Dequeue Element(error in (no error)=w44, queue=w45) -> (element=w46, error out=w47, queue out=w48)
    call "modulation_block.gvi"(modulation type=w32, PSK type=w31, pulse shaping filter=w33, filter parameter=w34, filter length=w35, input bit stream=w46, samples per symbol=w30, IQ_Rate=w42) -> (modulated_complex_waveform=w49)
    Get Queue Status(error in (no error)=w47, queue=w38) -> (# elements in queue=w50, error out=w51, queue out=w52)
    Lossy Enqueue Element(element=w49, error in (no error)=w51, queue=w52)
    $numOfElementInSoundQueue2 <- w43
    $numOfElementInRadioQueue <- w50
    stop if $stopDataEnqueing
  }
  Flush Queue(queue=w48) -> (queue out=w53)
  Release Queue(queue=w53)
  while {
    Get Queue Status(error in (no error)=w37, queue=w38) -> (# elements in queue=w54, error out=w55, queue out=w56)
    Dequeue Element(error in (no error)=w55, queue=w56) -> (element=w57, queue out=w58)
    call "addPadding.gvi"(dataIn=w57) -> (paddedDataOut=w59)
    call "niUSRP Write Tx Data (CDB Cluster).gvi"(session handle=w41, data=w59, end of data?=$stopSendingData) -> (session handle out=w60, Error Out=w61)
    $PacketGraph <- w59
    call "MT Format Constellation.gvi"(waveform=w59) -> (constellation graph=w62)
    $"IQ Graph" <- w62
    $numOfElementInRadioQueue2 <- w54
    stop if $stopSendingData
  }
  Flush Queue(queue=w58) -> (queue out=w63)
  Release Queue(queue=w63)
  call "niUSRP Close Session.gvi"(Handle in=w60, error in (no error)=w61)
