vi "Tx_soundtobitstream.gvi"   [LabVIEW NXG]
panel controls:
  "Packet Message Length (bits)": i32 = 128
  "stop": bool
panel indicators:
  "Array": i8[][]
  "File Length (bits)": i32
  "Number of Packets": i32
  "data": waveform<f64>[]
  "appended array": i16[]
types:
  T1 = cluster{"sample rate": f64, "number of channels": i32, "bits per sample": i32}
diagram:
  w1 = T1 {"sample rate"=44100, "number of channels"=1, "bits per sample"=16}
  call "Sound Input Configure.gvi"(device ID=0, sound format=w1) -> (task ID=w2, error out=w3)
  call "Sound Input Start.gvi"(task ID=w2, error in=w3) -> (task ID out=w4, error out=w5)
  while {
    call "Sound Input Read.gvi"(task ID=w4, error in=w5) -> (task ID out=w6, data=w7, error out=w8)
    $data <- w7
    for {
      w9 = each element of w7
      Property Node(instance in=w9) -> ("Y"=w10)
    }
    To Word Integer(number=w10) -> w11
    for {
      w12 = each element of w11
      Number To Boolean Array(number=w12) -> (Boolean array=w14)
      Boolean To Integer(Boolean=w14) -> (0, 1=w15)
      append w15 to w13
    }
    To Word Integer(number=w13) -> w16
    Array Size(array=w16) -> (size(s)=w17)
    Multiply Array Elements(numeric array=w17) -> (product=w18)
    Reshape Array(inArray=w16, size=w18) -> w19
    Array Size(array=w19) -> (size(s)=w20)
    Divide(x=w20, y=$"Packet Message Length (bits)") -> w21
    Round Toward Positive Infinity(x=w21) -> w22
    Multiply(w22, $"Packet Message Length (bits)") -> w23
    Subtract(x=w23, y=w20) -> w24
    To Long Integer(number=w24) -> w25
    Initialize Array(element=0, size=w25) -> w26
    Build Array[ConcatenateInputs=True](w19, w26) -> w27
    $"appended array" <- w27
    $Array <- w16
    $"File Length (bits)" <- w20
    To Long Integer(number=w22) -> w28
    $"Number of Packets" <- w28
    stop if $stop
  }
  call "Sound Input Stop.gvi"(task ID=w6, error in=w8) -> (task ID out=w29, error out=w30)
  call "Sound Input Clear.gvi"(task ID=w29, error in=w30)
